# Grasshopper definition FrameB_plan2.gh (Grasshopper 1.0.8)
# plug-ins: Karamba3D

P = Plane(PlaneXY(-0.001991094653, -7.189698482e-05, 0))
Z = UnitZ(Factor=Slider(1.2, range=0..10))
rectangle = Rectangle(Plane=P, XSize=Domain(-4, 4), YSize=Domain(-4, 4), Radius=0)  # -> Rectangle, Length
move = Move(Geometry=rectangle.Rectangle, Motion=Z)  # -> Geometry, Transform
move_2 = Move(Geometry=move.Geometry, Motion=Z)  # -> Geometry, Transform
debrep = DeconstructBrep(Brep=move_2.Geometry)  # -> Faces, Edges, Vertices
end = EndPoints(Curve=debrep.Edges)  # -> Start, End
debrep_2 = DeconstructBrep(Brep=move.Geometry)  # -> Faces, Edges, Vertices
debrep_3 = DeconstructBrep(Brep=rectangle.Rectangle)  # -> Faces, Edges, Vertices
end_2 = EndPoints(Curve=debrep_2.Edges)  # -> Start, End
devec = DeconstructVector(Vector=end.End)  # -> XComponent, YComponent, ZComponent
devec_2 = DeconstructVector(Vector=end.Start)  # -> XComponent, YComponent, ZComponent
devec_3 = DeconstructVector(Vector=end_2.End)  # -> XComponent, YComponent, ZComponent
devec_4 = DeconstructVector(Vector=end_2.Start)  # -> XComponent, YComponent, ZComponent
devec_5 = DeconstructVector(Vector=debrep_2.Vertices)  # -> XComponent, YComponent, ZComponent
devec_6 = DeconstructVector(Vector=debrep_3.Vertices)  # -> XComponent, YComponent, ZComponent
devec_7 = DeconstructVector(Vector=debrep.Vertices)  # -> XComponent, YComponent, ZComponent
round = Round(Number=devec_5.YComponent)  # -> Nearest, Floor, Ceiling
round_2 = Round(Number=devec_5.XComponent)  # -> Nearest, Floor, Ceiling
round_3 = Round(Number=devec_6.YComponent)  # -> Nearest, Floor, Ceiling
round_4 = Round(Number=devec_7.XComponent)  # -> Nearest, Floor, Ceiling
round_5 = Round(Number=devec.XComponent)  # -> Nearest, Floor, Ceiling
round_6 = Round(Number=devec.YComponent)  # -> Nearest, Floor, Ceiling
round_7 = Round(Number=devec_7.YComponent)  # -> Nearest, Floor, Ceiling
round_8 = Round(Number=devec_4.XComponent)  # -> Nearest, Floor, Ceiling
round_9 = Round(Number=devec_2.YComponent)  # -> Nearest, Floor, Ceiling
round_10 = Round(Number=devec_6.XComponent)  # -> Nearest, Floor, Ceiling
round_11 = Round(Number=devec_3.YComponent)  # -> Nearest, Floor, Ceiling
round_12 = Round(Number=devec_4.YComponent)  # -> Nearest, Floor, Ceiling
round_13 = Round(Number=devec_3.XComponent)  # -> Nearest, Floor, Ceiling
round_14 = Round(Number=devec_2.XComponent)  # -> Nearest, Floor, Ceiling
multiplication = Multiplication(A=devec_7.ZComponent, B=1000)
multiplication_2 = Multiplication(A=round_4.Nearest, B=1000)
multiplication_3 = Multiplication(A=round_7.Nearest, B=1000)
multiplication_4 = Multiplication(A=round_2.Nearest, B=1000)
multiplication_5 = Multiplication(A=round.Nearest, B=1000)
multiplication_6 = Multiplication(A=round_10.Nearest, B=1000)
multiplication_7 = Multiplication(A=devec_5.ZComponent, B=1000)
multiplication_8 = Multiplication(A=round_3.Nearest, B=1000)
multiplication_9 = Multiplication(A=round_8.Nearest, B=1000)
multiplication_10 = Multiplication(A=round_12.Nearest, B=1000)
multiplication_11 = Multiplication(A=devec_4.ZComponent, B=1000)
multiplication_12 = Multiplication(A=round_11.Nearest, B=1000)
multiplication_13 = Multiplication(A=round_13.Nearest, B=1000)
multiplication_14 = Multiplication(A=devec_3.ZComponent, B=1000)
multiplication_15 = Multiplication(A=round_14.Nearest, B=1000)
multiplication_16 = Multiplication(A=devec.ZComponent, B=1000)
multiplication_17 = Multiplication(A=round_9.Nearest, B=1000)
multiplication_18 = Multiplication(A=round_6.Nearest, B=1000)
multiplication_19 = Multiplication(A=devec_2.ZComponent, B=1000)
multiplication_20 = Multiplication(A=round_5.Nearest, B=1000)
vec = VectorXYZ(XComponent=multiplication_6, YComponent=multiplication_8, ZComponent=0)  # -> Vector, Length
vec_2 = VectorXYZ(XComponent=multiplication_13, YComponent=multiplication_12, ZComponent=multiplication_16)  # -> Vector, Length
vec_3 = VectorXYZ(XComponent=multiplication_2, YComponent=multiplication_3, ZComponent=multiplication)  # -> Vector, Length
vec_4 = VectorXYZ(XComponent=multiplication_4, YComponent=multiplication_5, ZComponent=multiplication_7)  # -> Vector, Length
vec_5 = VectorXYZ(XComponent=multiplication_9, YComponent=multiplication_10, ZComponent=multiplication_11)  # -> Vector, Length
vec_6 = VectorXYZ(XComponent=multiplication_13, YComponent=multiplication_12, ZComponent=multiplication_14)  # -> Vector, Length
vec_7 = VectorXYZ(XComponent=multiplication_9, YComponent=multiplication_10, ZComponent=multiplication_16)  # -> Vector, Length
item = ListItem(List=vec_7.Vector, Index=2, Wrap=True)
item_2 = ListItem(List=vec_5.Vector, Index=1, Wrap=True)
item_3 = ListItem(List=vec_5.Vector, Index=3, Wrap=True)
item_4 = ListItem(List=vec_5.Vector, Index=0, Wrap=True)
item_5 = ListItem(List=vec.Vector, Index=vec_7.Vector, Wrap=True)
ln = Line(StartPoint=vec_5.Vector, EndPoint=vec_6.Vector)
item_6 = ListItem(List=vec_5.Vector, Index=2, Wrap=True)
item_7 = ListItem(List=vec_7.Vector, Index=0, Wrap=True)
ln_2 = Line(StartPoint=vec_3.Vector, EndPoint=vec_4.Vector)
item_8 = ListItem(List=vec_7.Vector, Index=3, Wrap=True)
ln_3 = Line(StartPoint=vec_7.Vector, EndPoint=vec_2.Vector)
ln_4 = Line(StartPoint=vec_4.Vector, EndPoint=vec.Vector)
merge = Merge(Data1=ln_2, Data2=ln_4)
merge_2 = Merge(Data1=ln_3, Data2=ln)
matprops = MaterialPropertiesKaramba3D(
    FamilyOfMaterial="Concrete",
    Name="C40",
    YoungsModulus_kN_cm²=3250,
    InPlaneShearModulus_kN_cm²=1354,
    TransverseShearModulus_kN_cm²=1354,
    SpecificWeight_kN_m³=25,
    CoefficientOfThermalExpansion_1=1e-05,
    TensileStrength_kN_cm²=0.239,
    CompressiveStrength_kN_cm²=-2.68,
    StrengthHypothesis="MISES",
    mode="Isotrop")
srf4pt = _4PointSurface(CornerA=item_7, CornerB=item_5, CornerC=item, CornerD=item_8)
srf = Surface(srf4pt)
panel = Panel(matprops)

# ---- group: Crossection set
series = Series(Start=25, Step=5, Count=12)
series_2 = Series(Start=25, Step=5, Count=10)
series_3 = Series(Start=25, Step=5, Count=12)
series_4 = Series(Start=15, Step=5, Count=9)
series_5 = Series(Start=25, Step=5, Count=5)
crosec = CrossSectionKaramba3D(
    FamilyNameOfCrossSection="DefaultCroSec",
    ElementIdentifier="Plate",
    Material=matprops,
    Height_cm=flatten(series_5),
    mode="Shell - Const")
crosec_2 = CrossSectionKaramba3D(
    FamilyNameOfCrossSection="DefaultCroSec",
    ElementIdentifier="Beam",
    Material=matprops,
    Height_cm=series_3,
    UpperFlangeWidth_cm=series_4,
    LowerFlangeWidth_cm=series_4,
    mode="Trapezoid")
crosec_3 = CrossSectionKaramba3D(
    FamilyNameOfCrossSection="DefaultCroSec",
    ElementIdentifier="Column",
    Height_cm=series,
    UpperFlangeWidth_cm=series_2,
    LowerFlangeWidth_cm=series_2,
    mode="Trapezoid")
modify_crosec = ModifyCrossSectionKaramba3D(CrossSection=crosec_2, FamilyNameOfCrossSection="BeamSet", mode="Beam")
modify_crosec_2 = ModifyCrossSectionKaramba3D(CrossSection=crosec_3, FamilyNameOfCrossSection="ColumnSet", mode="Beam")

# ----
item_9 = ListItem(List=flatten(modify_crosec), Index=0, Wrap=False)  # -> flatten(Item)
item_10 = ListItem(List=flatten(modify_crosec_2), Index=0, Wrap=False)  # -> flatten(Item)
modify_crosec_3 = ModifyCrossSectionKaramba3D(CrossSection=crosec, FamilyNameOfCrossSection="PlateSet", mode="Shell")
item_11 = ListItem(List=flatten(modify_crosec_3), Index=0, Wrap=False)  # -> flatten(Item)
merge_3 = Merge(Data1=flatten(modify_crosec_2), Data2=flatten(modify_crosec), Data3=flatten(modify_crosec_3))
panel_2 = Panel(merge_3)

# ---- group: Reset Count Button
button = Button()

# ---- group: Elements And Model Defining
srf4pt_2 = _4PointSurface(CornerA=item_4, CornerB=item_2, CornerC=item_6, CornerD=item_3)
srf_2 = Surface(srf4pt_2)
lineelem = CreateLinearElementKaramba3D(
    Line=merge_2,
    Identifier="b",
    CrossSection=item_9,
    LimitDistance_m=0.005,
    BucklingLengthY_m=-1,
    BucklingLengthZ_m=-1,
    BucklingLengthLT_m=-1,
    Bending=True,
    ToPolylineMaxAngle=0.25,
    ToPolylineTolerance=0.1,
    ToPolylineMaxEdgeLength=0.25,
    New=True,
    Remove=True,
    mode="LineToBeam")  # -> Element, Points, Info
lineelem_2 = CreateLinearElementKaramba3D(
    Line=merge,
    Identifier="c",
    CrossSection=item_10,
    LimitDistance_m=0.005,
    BucklingLengthY_m=-1,
    BucklingLengthZ_m=-1,
    BucklingLengthLT_m=-1,
    Bending=True,
    ToPolylineMaxAngle=0.25,
    ToPolylineTolerance=0.1,
    ToPolylineMaxEdgeLength=0.25,
    New=True,
    Remove=True,
    mode="LineToBeam")  # -> Element, Points, Info
merge_4 = Merge(Data1=lineelem.Element, Data2=lineelem_2.Element)
supp = SupportKaramba3D(PosInd=vec.Vector, Ct_kN_m=Vector(0, 0, 0), Cr_kNm_rad=Vector(0, 0, 0), menu=[buttons(on, on, on, on, on, on)])
joint_agent = BeamJointAgentKaramba3D(BeamIdentifier=merge_4, Ct_kN_m=Vector(0, 0, 0), Cr_kNm_rad=Vector(0, 0, 0), menu=[buttons(on, on, on, on, on, on)])

# ----
merge_5 = Merge(Data1=srf_2, Data2=srf)

# ---- group: Elements And Model Defining (continued)
surfelem = CreateSurfaceElementKaramba3D(Mesh=merge_5, Identifier="f", CrossSection=item_11, LimitDistance_m=0.005, Bending=True, mode="MeshToShell")  # -> Element, Points, Info
merge_6 = Merge(Data1=lineelem_2.Element, Data2=lineelem.Element, Data3=surfelem.Element)

# ----
assemble = AssembleModelKaramba3D(Elem=flatten(merge_6), Support=flatten(supp), LimitDistance_mm=0.005)  # -> Model, Info, Mass_kg, CentreOfGravity, LoadCaseNames

# ---- group: WindLoad
# Notes: The input for this windload calculator is the frame building (with only beams and columns!!!!)
py3 = Python3Script(x=assemble.Model)  # -> out, a
# ---------- py3: Python ----------
import Rhino.Geometry as rg
import math
import System
import Karamba.Elements as ke
import clr
clr.AddReference("System")
from System import Array, Int32

def find_leftmost_frame_elements(k_model, tolerance=0.01):
    """
    Identifies beam elements that form the leftmost frame of the Karamba model.
    Only ModelBeam elements are processed.

    Args:
        k_model (Karamba.Models.Model): The Karamba model.
        tolerance (float): Tolerance for determining if an element is "leftmost".

    Returns:
        tuple: A tuple containing lists of (leftmost_elements, leftmost_elem_indices, 
               leftmost_start_pts, leftmost_end_pts, leftmost_mid_pts, leftmost_lines, 
               leftmost_lengths). Returns empty lists if no suitable elements are found.
    """
    all_element_data = []
    
    # print(f"Finding leftmost frame elements...") # Removed for cleaner output
    # print(f"Total elements in k_model: {len(k_model.elems) if k_model and hasattr(k_model, 'elems') else 0}")
    
    processed_beam_count = 0
    for i, elem in enumerate(k_model.elems):
        current_elem_class_name = elem.__class__.__name__
        
        if current_elem_class_name != 'ModelBeam':
            # print(f"  Skipping element {i} (class: {current_elem_class_name}) as it's not a 'ModelBeam'.") # Removed for cleaner output
            continue 

        processed_beam_count += 1
        try:
            node_indices = list(elem.node_inds)
            if len(node_indices) >= 2:
                k_node1 = k_model.nodes[int(node_indices[0])]
                k_node2 = k_model.nodes[int(node_indices[1])]
                
                p1_kar = k_node1.pos
                p2_kar = k_node2.pos
                
                p1_rhino = rg.Point3d(p1_kar.X, p1_kar.Y, p1_kar.Z)
                p2_rhino = rg.Point3d(p2_kar.X, p2_kar.Y, p2_kar.Z)
                
                mid_p = (p1_rhino + p2_rhino) / 2.0
                line = rg.Line(p1_rhino, p2_rhino)
                
                all_element_data.append((i, elem, p1_rhino, p2_rhino, mid_p, line))
            else:
                print(f"  Warning: ModelBeam element {i} has less than 2 node_inds: {node_indices}")
        except Exception as e:
            print(f"  Error processing ModelBeam element {i} geometry: {e}")
            continue

    # print(f"Processed {processed_beam_count} 'ModelBeam' elements.") # Removed for cleaner output
    # print(f"Successfully extracted geometry for {len(all_element_data)} beams.") # Removed for cleaner output

    if not all_element_data:
        print("  No valid beam elements found with geometry. Returning empty lists.")
        return [], [], [], [], [], [], []

    # Find minimum X-coordinate among the midpoints of the beam elements
    min_x = float('inf')
    for data in all_element_data:
        mid_p = data[4] 
        if mid_p.X < min_x:
            min_x = mid_p.X
    # print(f"  Minimum X-coordinate found for beam midpoints: {min_x}") # Removed for cleaner output

    # Filter for elements whose mid_p.X is close to min_x (within tolerance)
    leftmost_elements = []
    leftmost_elem_indices = []
    leftmost_start_pts = []
    leftmost_end_pts = []
    leftmost_mid_pts = []
    leftmost_lines = []
    leftmost_lengths = []

    for data in all_element_data:
        original_index, original_elem, p1, p2, mid_p, line = data
        if abs(mid_p.X - min_x) < tolerance:
            leftmost_elements.append(original_elem)
            leftmost_elem_indices.append(int(original_index))
            leftmost_start_pts.append(p1)
            leftmost_end_pts.append(p2)
            leftmost_mid_pts.append(mid_p)
            leftmost_lines.append(line)
            leftmost_lengths.append(line.Length)
    
    # print(f"Found {len(leftmost_elem_indices)} leftmost beam elements.") # Removed for cleaner output
    return (leftmost_elements, leftmost_elem_indices, leftmost_start_pts, 
            leftmost_end_pts, leftmost_mid_pts, leftmost_lines, leftmost_lengths)

def calculate_wind_load(height, width, depth):
    """
    Calculates the total wind load (R) for a structure.
    All dimensions should be in meters.

    Args:
        height (float): Structure height in meters.
        width (float): Structure width (Y-dimension) in meters.
        depth (float): Structure depth (X-dimension) in meters.

    Returns:
        float: Total wind force R in kN.
    """
    # Simplified constants for demonstration, replace with actual code/standard values if needed
    Q_oz = 3.7 * (height/500) ** 0.16  # kPa (example formula)
    S_t = 1.0
    S_theta = 0.82
    Q_z = Q_oz * S_t * S_theta 

    try:
        if width == 0 or height == 0:
            print(f"  Warning: Critical dimension is zero (H={height}m, W={width}m). Returning 0.0 for wind load.")
            return 0.0

        # Use a safe_depth to prevent division by zero or extreme values in ratios
        # If actual depth is 0, assume a minimal thickness (e.g., 1mm) for calculation stability.
        safe_depth = max(depth, 0.001) 
        if depth == 0:
            print(f"  Warning: Model depth is 0. Using safe_depth={safe_depth}m for calculations to prevent errors.")

        ratio_h_w = height / width
        
        # This formula is sensitive to width/depth ratio
        log_arg = 0.6 * (width/safe_depth) - 0.011 * ratio_h_w
        
        if log_arg <= 0:
            print(f"  Warning: log_arg ({log_arg}) was non-positive. Using fallback C_f = 1.1.")
            C_f = 1.1 # Fallback value
        else:
            C_f = 1.1 + 0.055 * ratio_h_w / (math.exp(abs(math.log(log_arg))) ** (1.7 - 0.0013 * ratio_h_w**2))
    except Exception as e:
        print(f"  Error calculating C_f: {e}. Using fallback C_f = 1.1.")
        C_f = 1.1 # Fallback value
    
    S_q_h = 0.5 + ((1.1 - 0.5)**2 + 0.25/(width**0.5 * height * 0.02))**0.5
    S_q_z = S_q_h - 1.2 * (S_q_h - (10/height)**0.14) * 0.5  
    
    w = Q_z * C_f * S_q_z  # kPa
    R = w * height * width  # kN (Assuming wind acts on height * width area)
    
    return R

# --- Main Execution Block ---

# Initialize output variables
R_value = 0.0
Beam_loads = 0.0 
Beam_indices = []

model = x # Input Karamba model
tolerance_val = 0.01

if not model:
    print("Error: Model input 'x' is None or empty. No processing performed.")
else:
    try:
        # 1. Find leftmost frame elements
        l_elems, l_indices, l_s_pts, l_e_pts, l_m_pts, l_lines, l_lengths = \
            find_leftmost_frame_elements(model, tolerance_val)
        
        # 2. Calculate overall model dimensions for wind load
        all_model_points = []
        if model.nodes:
            for node in model.nodes:
                all_model_points.append(rg.Point3d(node.pos.X, node.pos.Y, node.pos.Z))

        if not all_model_points:
            print("Error: No nodes found in the model for bounding box calculation. Cannot calculate wind load.")
        else:
            bbox_model = rg.BoundingBox(all_model_points)
            
            # Convert dimensions from internal units (mm) to meters for windload function
            height = (bbox_model.Max.Z - bbox_model.Min.Z) / 1000.0 # meters
            width = (bbox_model.Max.Y - bbox_model.Min.Y) / 1000.0  # meters  
            depth = (bbox_model.Max.X - bbox_model.Min.X) / 1000.0   # meters
            
            # print(f"Calculated overall model dimensions (m): H={height:.3f}, W={width:.3f}, D={depth:.3f}") # Removed for cleaner output
                
            # 3. Calculate wind load and distribute it if leftmost beams are found
            if l_indices: 
                wind_force_R = calculate_wind_load(height, width, depth)
                # print(f"Calculated total wind force (R): {wind_force_R:.3f} kN") # Removed for cleaner output
                
                total_beam_length_mm = sum(l_lengths)
                
                if total_beam_length_mm > 0:
                    total_beam_length_cm = total_beam_length_mm / 10.0 # cm
                    
                    if total_beam_length_cm > 0:
                        beam_load_KN_per_cm = wind_force_R / total_beam_length_cm # kN/cm
                        Beam_loads = beam_load_KN_per_cm 
                        # print(f"Distributed load on leftmost beams: {Beam_loads:.6f} kN/cm") # Removed for cleaner output
                    else:
                        print("Warning: Total length of leftmost beams (cm) is zero. Distributed load cannot be calculated.")
                else:
                    print("Warning: Total length of leftmost beams (mm) is zero. Distributed load cannot be calculated.")
            else: 
                print("Warning: No leftmost beams found for load distribution. Wind load and distributed load set to 0.")

            R_value = wind_force_R if 'wind_force_R' in locals() else 0.0 # Ensure R_value is assigned even if no leftmost_beams
            Beam_indices = l_indices

    except Exception as e:
        print(f"An unexpected error occurred in the main execution block: {e}")

# --- Final Output ---
print(R_value) 
print(Beam_loads)
if Beam_indices:
    for i in range(len(Beam_indices)):
      print(int(Beam_indices[i]))
else:
    print("  None")
# ---------- end py3 ----------
item_12 = ListItem(List=flatten(py3.out), Index=0, Wrap=False)  # -> flatten(Item)
item_13 = ListItem(List=flatten(py3.out), Index=1, Wrap=False)
split = SplitList(List=py3.out, Index=2)  # -> ListA, ListB

# ---- group: LoadCombination
vec_8 = VectorXYZ(XComponent=0, YComponent=0, ZComponent=-5)  # -> Vector, Length
vec_9 = VectorXYZ(XComponent=item_13, YComponent=0, ZComponent=0)  # -> Vector, Length
beam_loads = BeamLoadsKaramba3D(
    BeamIdentifier=flatten(split.ListB),
    LoadCase="WL",
    ForceVector=vec_9.Vector,
    TStart=0,
    TEnd=1,
    mode="Block",
    menu=[buttons(off, off, on)])  # -> flatten(Load)
loads = LoadsKaramba3D(
    Vector=vec_8.Vector,
    Mesh=flatten(merge_5),
    LCase="VL",
    mode="MeshLoad -Const.",
    menu=[buttons(off, on, off), buttons(on, on)])
loads_2 = LoadsKaramba3D(Vector=Vector(0, 0, -1), LCase="SW", mode="Gravity")
lccombinator = LoadCaseCombinatorKaramba3D(LoadCaseCombinationRulesKaramba3D=["ULS1 = 1.4*SW + 1.6*VL", "ULS2 = 0.9*SW + 1.4*WL ", "ULS3 = 1.2*SW +1.2*VL + 1.4*WL"])  # -> LoadCaseCombinations, NamesOfLoadCases, NumberOfLoadCases
merge_7 = Merge(Data1=loads_2, Data2=loads, Data3=beam_loads, Data4=lccombinator.LoadCaseCombinations)
load = LoadKaramba3D(flatten(merge_7))

# ----
panel_3 = Panel(item_13)
assemble_2 = AssembleModelKaramba3D(Elem=flatten(merge_6), Support=flatten(supp), Load=flatten(load), Joint=joint_agent, LimitDistance_mm=0.005)  # -> Model, Info, Mass_kg, CentreOfGravity, LoadCaseNames
analyse = AnalyseKaramba3D(Model=assemble_2.Model)  # -> AnalysedModel, MaximumDisplacement_cm, ResultingForce_kN, ChangeOfElasticEnergy_kNm
py3_2 = Python3Script(x=assemble.Model)  # -> out, a
# ---------- py3_2: Python ----------
import math
import clr
clr.AddReference("KarambaCommon")
# Import specific types to avoid confusion and ensure correct type checking
from Karamba.Models import Model
from Karamba.Elements import ModelBeam 

def get_all_model_data(k_model):
    """
    Extracts all node coordinates and only Karamba ModelBeam element connection data.
    
    Args:
        k_model (Karamba.Models.Model): The Karamba model object.

    Returns:
        tuple: A tuple containing two lists:
               - node_coords (list of tuples): (x, y, z) coordinates for each node.
               - elem_raw_info (list of tuples): (original_ElemID, StartNodeID, EndNodeID) for ModelBeam elements.
    """
    node_coords = [] # Stores (x, y, z) tuples for quick lookup
    if not hasattr(k_model, 'nodes') or not k_model.nodes:
        print("Error: Karamba model has no nodes.")
        return [], []

    for node in k_model.nodes:
        node_coords.append((node.pos.X, node.pos.Y, node.pos.Z))

    elem_raw_info = [] # Stores (original_ElemID, StartNodeID, EndNodeID) for beams

    if not hasattr(k_model, 'elems') or not k_model.elems:
        print("Error: Karamba model has no elements.")
        return node_coords, []

    for i, elem in enumerate(k_model.elems):
        # Specific filter: Only process Beams (Ignore shells, trusses if needed, etc.)
        if elem.__class__.__name__ != 'ModelBeam':
            continue

        if not hasattr(elem, "node_inds") or elem.node_inds is None or elem.node_inds.Count < 2:
            print(f"Warning: ModelBeam element {i} has insufficient node indices. Skipping.")
            continue

        try:
            n_start = elem.node_inds[0]
            n_end = elem.node_inds[1]
        except IndexError:
            print(f"Warning: Could not get start/end node for ModelBeam element {i}. Skipping.")
            continue

        elem_raw_info.append((i, n_start, n_end)) 

    return node_coords, elem_raw_info

# --- GH Python Battery Execution ---

# Initialize outputs
filtered_nodes_csv = []
filtered_elements_csv = []

model_in = x
# Removed y input (z_limit_in) logic

if not model_in:
    print("Error: Input 'model_in' (x) is not connected or is None.")
else:
    # Attempt to unwrap Karamba Model object
    k_model_raw = model_in 
    try:
        if hasattr(model_in, 'Value'): 
            k_model_raw = model_in.Value 
    except Exception:
        pass 

    if not isinstance(k_model_raw, Model):
        print(f"Error: Input 'model_in' (x) is not a valid Karamba Model object. Actual type: {type(k_model_raw)}")
    else:
        k_model = k_model_raw
        
        # 1. Extract ALL beams and nodes
        node_coords, beam_elem_info = get_all_model_data(k_model)

        print(f"Info: Processing all ModelBeam elements. Total Beams found: {len(beam_elem_info)}")

        selected_elems_data = [] 
        selected_node_ids = set() 
        
        # 2. Loop through all found beams and prepare for export
        # (Previously this loop filtered by Z-height, now it accepts all)
        for elem_id, n_start, n_end in beam_elem_info:
            if n_start >= len(node_coords) or n_end >= len(node_coords):
                print(f"Warning: Node index out of bounds for beam element {elem_id}. Skipping.")
                continue
            
            # Directly add element data without Z check
            selected_elems_data.append((elem_id, n_start, n_end))
            selected_node_ids.add(n_start)
            selected_node_ids.add(n_end)

        # 3. Build CSV data for elements
        filtered_elements_csv.append("ElemID,StartNodeID,EndNodeID")
        for elem_id, n_start, n_end in selected_elems_data:
            filtered_elements_csv.append("{},{},{}".format(elem_id, n_start, n_end))

        # 4. Build CSV data for nodes (Only nodes referenced by beams)
        filtered_nodes_csv.append("NodeID,X,Y,Z")
        for node_id in sorted(list(selected_node_ids)):
            if node_id < len(node_coords):
                x_coord, y_coord, z_coord = node_coords[node_id]
                filtered_nodes_csv.append("{},{:.4f},{:.4f},{:.4f}".format(node_id, x_coord, y_coord, z_coord))

# Assign results to GH Python battery outputs
a = filtered_nodes_csv
b = filtered_elements_csv

# Print for verification
print(a)
print(b)
# ---------- end py3_2 ----------
panel_4 = Panel(py3_2.out)
modelview = ModelViewKaramba3D(Model=analyse.AnalysedModel)  # -> Model, DeformedMesh, DeformedAxes, DeformedModel, MaximumDeformation
panel_5 = Panel(analyse.MaximumDisplacement_cm)
item_14 = ListItem(List=panel_4, Index=1, Wrap=True)
item_15 = ListItem(List=panel_4, Index=2, Wrap=True)
panel_6 = Panel(item_14)
panel_7 = Panel(modelview.Model)
panel_8 = Panel(item_15)
py3_3 = Python3Script(x=panel_6, y=button)  # -> out, a; inputs x: list
# ---------- py3_3: Python ----------
import os
import scriptcontext as sc
import datetime  # Used for timestamp in status messages.
import ast       # Used for safe evaluation of string literal lists in input 'x'.

# --- GH Python Component Inputs ---
# x (data_to_save_raw): Connects to the data list to be saved. (LIST ACCESS required)
data_to_save_raw = x 
# y (reset_button_input): Connects to a Boolean button (e.g., Grasshopper Button).
#                         Pressing this button (False to True transition) will reset 
#                         the 'current_dataset_id' and the save activation state.
#                         Ensure 'Item Access' is set in Grasshopper for this input.
reset_button_input = y

# Hardcoded filename for this specific component instance.
file_base_name_in = 'coordinates' 

# Control flags for saving behavior, hardcoded as per user request.
# This setup results in: Save on the very first run, then continuous saving on subsequent runs.
_save_once_control_state = True      # Internal flag corresponding to a "Save Once" button logic.
_continuous_save_control_state = True # Internal flag corresponding to a "Continuous Save" toggle logic.


# --- Helper Function: Save/Append to CSV ---
def save_list_to_csv(data_list, file_path):
    """
    Saves a list of strings (each representing a CSV line) to a specified file path.
    Appends data if the file exists (skipping the header from data_list),
    otherwise creates a new file. Creates parent directories if needed.
    """
    if not isinstance(data_list, (list, tuple)) or not data_list:
        return f"Error: Input data for saving is not a non-empty list or tuple. Type: {type(data_list)}"

    try:
        dir_name = os.path.dirname(file_path)
        if dir_name:
            os.makedirs(dir_name, exist_ok=True)

        file_exists = os.path.exists(file_path)
        mode = 'a' if file_exists else 'w'

        with open(file_path, mode, encoding='utf-8') as f:
            # If appending to an existing file, skip the first item (header) from the new data.
            start_index = 1 if file_exists and len(data_list) > 0 else 0 
            for i in range(start_index, len(data_list)):
                f.write(str(data_list[i]) + '\n')
        
        current_status_time = datetime.datetime.now().strftime('%H:%M:%S') 
        action = "Appended" if file_exists else "Created"
        return f"[{current_status_time}] Successfully {action} and saved to: {file_path}"
    except Exception as e:
        return f"Error saving file {file_path}: {e}"

# --- GH Python Component Execution ---

save_status = "Ready to save." # Initialize output status message.
error_occurred = False        # Flag for issues during data preprocessing.
was_reset_this_solve = False  # Flag to prevent saving if a reset was triggered this solve.

# Use sc.sticky for persistent data storage unique to this component instance.
sticky_data = sc.sticky 

# --- Initialize or Retrieve Sticky Variables ---
# 'last_save_once_state': Stores the state of the '_save_once_control_state' from the previous solve.
# This helps detect the initial "press" for 'save once' logic.
if 'last_save_once_state' not in sticky_data:
    sticky_data['last_save_once_state'] = False

# 'is_continuous_saving_active': Flag indicating if continuous saving has been activated.
# Activated after the first "save once" trigger.
if 'is_continuous_saving_active' not in sticky_data:
    sticky_data['is_continuous_saving_active'] = False

# 'current_dataset_id': Unique sequential ID for each saved dataset. Starts at 0.
if 'current_dataset_id' not in sticky_data:
    sticky_data['current_dataset_id'] = 0

# 'last_reset_button_state': Stores the boolean state of the 'reset_button_input' from the previous solve.
# This allows detection of a False -> True transition (button press).
if 'last_reset_button_state' not in sticky_data:
    sticky_data['last_reset_button_state'] = False

# Retrieve states from sticky for current solve's logic.
last_save_once_state = sticky_data['last_save_once_state']
is_continuous_saving_active = sticky_data['is_continuous_saving_active']

# --- Reset Logic: Detect 'y' button press (False to True transition) ---
current_reset_button_state = reset_button_input
last_reset_button_state_from_sticky = sticky_data['last_reset_button_state']

if current_reset_button_state and not last_reset_button_state_from_sticky:
    # A reset has been triggered!
    # Reset 'current_dataset_id' to 0.
    sticky_data['current_dataset_id'] = 0
    # Reset save activation states to re-initiate the "save once then continuous" cycle.
    sticky_data['last_save_once_state'] = False 
    sticky_data['is_continuous_saving_active'] = False
    
    save_status = f"[{datetime.datetime.now().strftime('%H:%M:%S')}] Dataset ID and save activation states have been reset."
    was_reset_this_solve = True # Prevent saving data in the same solve a reset occurred.
    
# Always update the last state of the reset button for the next solve.
sticky_data['last_reset_button_state'] = current_reset_button_state

# --- Data Preprocessing: Flatten potential string-list-literals from input 'x' ---
# Handles cases where 'x' might receive string representations of lists (e.g., from a Panel),
# flattening them into a single list of raw data strings.
actual_data_to_save = [] 
if data_to_save_raw:
    # Check if the first item looks like a string representation of a list.
    is_x_a_list_of_string_lists = isinstance(data_to_save_raw, list) and len(data_to_save_raw) > 0 and \
                                   isinstance(data_to_save_raw[0], str) and data_to_save_raw[0].strip().startswith('[')
    
    if is_x_a_list_of_string_lists:
        for item_str_literal in data_to_save_raw:
            if isinstance(item_str_literal, str):
                try:
                    inner_data = ast.literal_eval(item_str_literal)
                    if isinstance(inner_data, list):
                        actual_data_to_save.extend(inner_data) 
                    else:
                        actual_data_to_save.append(str(inner_data))
                except (ValueError, SyntaxError) as e:
                    save_status = f"Error: Input data format issue - cannot parse '{item_str_literal}' as a Python literal: {e}"
                    error_occurred = True 
                    break 
            else:
                actual_data_to_save.append(str(item_str_literal))
    else: # If data_to_save_raw is already a flat list of strings/objects, use it directly.
        actual_data_to_save = data_to_save_raw
else:
    actual_data_to_save = [] # Ensure it's an empty list if no input is provided.

# --- Only proceed with save logic if no preprocessing error occurred and no reset happened ---
if not error_occurred and not was_reset_this_solve:
    # --- Determine if a save operation should be performed ---
    # 'save_once_pressed' detects the initial transition of '_save_once_control_state' from False to True.
    # Since '_save_once_control_state' is hardcoded True, this will be True only on the very first component solve,
    # or after a reset.
    save_once_pressed = _save_once_control_state and not last_save_once_state

    # Activate continuous saving after the initial 'save once' trigger.
    # Since '_continuous_save_control_state' is hardcoded True, 'is_continuous_saving_active' will
    # become True on the first solve (when 'save_once_pressed' is True) and remain True thereafter,
    # or until a reset.
    if _continuous_save_control_state and save_once_pressed: 
        is_continuous_saving_active = True

    should_perform_save = False
    if save_once_pressed: # Condition for the very first save (or first after reset).
        should_perform_save = True
    elif _continuous_save_control_state and is_continuous_saving_active: # Condition for all subsequent continuous saves.
        should_perform_save = True

    # --- Execute save logic if conditions are met ---
    if should_perform_save:
        gh_doc_path = sc.doc.Path
        
        if not gh_doc_path:
            save_status = "Error: Grasshopper document not saved. Save the .gh file first to determine output path."
        else:
            gh_doc_dir = os.path.dirname(gh_doc_path)
            data_subfolder_name = "data_save"
            target_dir = os.path.join(gh_doc_dir, data_subfolder_name)
            
            if not file_base_name_in:
                save_status = "Error: Please provide a 'file_base_name' for the output CSV."
            else:
                final_file_name = f"{file_base_name_in}.csv"
                full_file_path = os.path.join(target_dir, final_file_name)
                
                if not actual_data_to_save:
                    save_status = f"Warning: Input data for '{final_file_name}' is empty. No data will be written to: {full_file_path}"
                else:
                    # Get the current dataset ID before using it for this save operation.
                    current_dataset_id_for_save = sticky_data['current_dataset_id']
                    
                    data_with_dataset_id = []
                    
                    # Assume the first item in 'actual_data_to_save' is the header.
                    # Prepend "Dataset_ID" to the original header.
                    original_header = actual_data_to_save[0]
                    data_with_dataset_id.append(f"Dataset_ID,{original_header}")
                    
                    # Prepend the current dataset ID to each data row.
                    for i in range(1, len(actual_data_to_save)):
                        data_with_dataset_id.append(f"{current_dataset_id_for_save},{actual_data_to_save[i]}")

                    # Pass the prepared data to the saving function.
                    save_status = save_list_to_csv(data_with_dataset_id, full_file_path)
                    
                    # AFTER a successful save, increment the counter for the NEXT save.
                    sticky_data['current_dataset_id'] += 1
                
    else:
        # --- Set status message if no save is performed ---
        # This branch is typically reached if data is empty, or document path is missing,
        # or during the very first solve before continuous saving is fully active, but controls are set to True.
        
        if _continuous_save_control_state and is_continuous_saving_active:
            save_status = f"Continuous saving active. Data will be saved on every solve. [{datetime.datetime.now().strftime('%H:%M:%S')}]"
        elif _save_once_control_state: 
            save_status = f"Save triggered once. Waiting for continuous save activation. [{datetime.datetime.now().strftime('%H:%M:%S')}]"
        else: # This branch is practically unreachable with current hardcoded settings.
            save_status = "Save controls are OFF (unreachable with current settings)."

    # Always update the sticky states for the next run, unless a reset just happened.
    # If a reset happened, sticky states were already modified at the beginning of the script.
    if not was_reset_this_solve:
        sticky_data['last_save_once_state'] = _save_once_control_state
        sticky_data['is_continuous_saving_active'] = is_continuous_saving_active

# Assign the final status message to the Grasshopper Python output 'a'.
a = save_status

# Print the status message to the Grasshopper console for inspection.
print(a)
# ---------- end py3_3 ----------
py3_4 = Python3Script(x=panel_8, y=button)  # -> out, a; inputs x: list
# ---------- py3_4: Python ----------
import os
import scriptcontext as sc
import datetime  # Used for timestamp in status messages.
import ast       # Used for safe evaluation of string literal lists in input 'x'.

# --- GH Python Component Inputs ---
# x (data_to_save_raw): Connects to the data list to be saved. (LIST ACCESS required)
data_to_save_raw = x 
# y (reset_button_input): Connects to a Boolean button (e.g., Grasshopper Button).
#                         Pressing this button (False to True transition) will reset 
#                         the 'current_dataset_id' and the save activation state.
#                         Ensure 'Item Access' is set in Grasshopper for this input.
reset_button_input = y

# Hardcoded filename for this specific component instance.
file_base_name_in = 'connection' 

# Control flags for saving behavior, hardcoded as per user request.
# This setup results in: Save on the very first run, then continuous saving on subsequent runs.
_save_once_control_state = True      # Internal flag corresponding to a "Save Once" button logic.
_continuous_save_control_state = True # Internal flag corresponding to a "Continuous Save" toggle logic.


# --- Helper Function: Save/Append to CSV ---
def save_list_to_csv(data_list, file_path):
    """
    Saves a list of strings (each representing a CSV line) to a specified file path.
    Appends data if the file exists (skipping the header from data_list),
    otherwise creates a new file. Creates parent directories if needed.
    """
    if not isinstance(data_list, (list, tuple)) or not data_list:
        return f"Error: Input data for saving is not a non-empty list or tuple. Type: {type(data_list)}"

    try:
        dir_name = os.path.dirname(file_path)
        if dir_name:
            os.makedirs(dir_name, exist_ok=True)

        file_exists = os.path.exists(file_path)
        mode = 'a' if file_exists else 'w'

        with open(file_path, mode, encoding='utf-8') as f:
            # If appending to an existing file, skip the first item (header) from the new data.
            start_index = 1 if file_exists and len(data_list) > 0 else 0 
            for i in range(start_index, len(data_list)):
                f.write(str(data_list[i]) + '\n')
        
        current_status_time = datetime.datetime.now().strftime('%H:%M:%S') 
        action = "Appended" if file_exists else "Created"
        return f"[{current_status_time}] Successfully {action} and saved to: {file_path}"
    except Exception as e:
        return f"Error saving file {file_path}: {e}"

# --- GH Python Component Execution ---

save_status = "Ready to save." # Initialize output status message.
error_occurred = False        # Flag for issues during data preprocessing.
was_reset_this_solve = False  # Flag to prevent saving if a reset was triggered this solve.

# Use sc.sticky for persistent data storage unique to this component instance.
sticky_data = sc.sticky 

# --- Initialize or Retrieve Sticky Variables ---
# 'last_save_once_state': Stores the state of the '_save_once_control_state' from the previous solve.
# This helps detect the initial "press" for 'save once' logic.
if 'last_save_once_state' not in sticky_data:
    sticky_data['last_save_once_state'] = False

# 'is_continuous_saving_active': Flag indicating if continuous saving has been activated.
# Activated after the first "save once" trigger.
if 'is_continuous_saving_active' not in sticky_data:
    sticky_data['is_continuous_saving_active'] = False

# 'current_dataset_id': Unique sequential ID for each saved dataset. Starts at 0.
if 'current_dataset_id' not in sticky_data:
    sticky_data['current_dataset_id'] = 0

# 'last_reset_button_state': Stores the boolean state of the 'reset_button_input' from the previous solve.
# This allows detection of a False -> True transition (button press).
if 'last_reset_button_state' not in sticky_data:
    sticky_data['last_reset_button_state'] = False

# Retrieve states from sticky for current solve's logic.
last_save_once_state = sticky_data['last_save_once_state']
is_continuous_saving_active = sticky_data['is_continuous_saving_active']

# --- Reset Logic: Detect 'y' button press (False to True transition) ---
current_reset_button_state = reset_button_input
last_reset_button_state_from_sticky = sticky_data['last_reset_button_state']

if current_reset_button_state and not last_reset_button_state_from_sticky:
    # A reset has been triggered!
    # Reset 'current_dataset_id' to 0.
    sticky_data['current_dataset_id'] = 0
    # Reset save activation states to re-initiate the "save once then continuous" cycle.
    sticky_data['last_save_once_state'] = False 
    sticky_data['is_continuous_saving_active'] = False
    
    save_status = f"[{datetime.datetime.now().strftime('%H:%M:%S')}] Dataset ID and save activation states have been reset."
    was_reset_this_solve = True # Prevent saving data in the same solve a reset occurred.
    
# Always update the last state of the reset button for the next solve.
sticky_data['last_reset_button_state'] = current_reset_button_state

# --- Data Preprocessing: Flatten potential string-list-literals from input 'x' ---
# Handles cases where 'x' might receive string representations of lists (e.g., from a Panel),
# flattening them into a single list of raw data strings.
actual_data_to_save = [] 
if data_to_save_raw:
    # Check if the first item looks like a string representation of a list.
    is_x_a_list_of_string_lists = isinstance(data_to_save_raw, list) and len(data_to_save_raw) > 0 and \
                                   isinstance(data_to_save_raw[0], str) and data_to_save_raw[0].strip().startswith('[')
    
    if is_x_a_list_of_string_lists:
        for item_str_literal in data_to_save_raw:
            if isinstance(item_str_literal, str):
                try:
                    inner_data = ast.literal_eval(item_str_literal)
                    if isinstance(inner_data, list):
                        actual_data_to_save.extend(inner_data) 
                    else:
                        actual_data_to_save.append(str(inner_data))
                except (ValueError, SyntaxError) as e:
                    save_status = f"Error: Input data format issue - cannot parse '{item_str_literal}' as a Python literal: {e}"
                    error_occurred = True 
                    break 
            else:
                actual_data_to_save.append(str(item_str_literal))
    else: # If data_to_save_raw is already a flat list of strings/objects, use it directly.
        actual_data_to_save = data_to_save_raw
else:
    actual_data_to_save = [] # Ensure it's an empty list if no input is provided.

# --- Only proceed with save logic if no preprocessing error occurred and no reset happened ---
if not error_occurred and not was_reset_this_solve:
    # --- Determine if a save operation should be performed ---
    # 'save_once_pressed' detects the initial transition of '_save_once_control_state' from False to True.
    # Since '_save_once_control_state' is hardcoded True, this will be True only on the very first component solve,
    # or after a reset.
    save_once_pressed = _save_once_control_state and not last_save_once_state

    # Activate continuous saving after the initial 'save once' trigger.
    # Since '_continuous_save_control_state' is hardcoded True, 'is_continuous_saving_active' will
    # become True on the first solve (when 'save_once_pressed' is True) and remain True thereafter,
    # or until a reset.
    if _continuous_save_control_state and save_once_pressed: 
        is_continuous_saving_active = True

    should_perform_save = False
    if save_once_pressed: # Condition for the very first save (or first after reset).
        should_perform_save = True
    elif _continuous_save_control_state and is_continuous_saving_active: # Condition for all subsequent continuous saves.
        should_perform_save = True

    # --- Execute save logic if conditions are met ---
    if should_perform_save:
        gh_doc_path = sc.doc.Path
        
        if not gh_doc_path:
            save_status = "Error: Grasshopper document not saved. Save the .gh file first to determine output path."
        else:
            gh_doc_dir = os.path.dirname(gh_doc_path)
            data_subfolder_name = "data_save"
            target_dir = os.path.join(gh_doc_dir, data_subfolder_name)
            
            if not file_base_name_in:
                save_status = "Error: Please provide a 'file_base_name' for the output CSV."
            else:
                final_file_name = f"{file_base_name_in}.csv"
                full_file_path = os.path.join(target_dir, final_file_name)
                
                if not actual_data_to_save:
                    save_status = f"Warning: Input data for '{final_file_name}' is empty. No data will be written to: {full_file_path}"
                else:
                    # Get the current dataset ID before using it for this save operation.
                    current_dataset_id_for_save = sticky_data['current_dataset_id']
                    
                    data_with_dataset_id = []
                    
                    # Assume the first item in 'actual_data_to_save' is the header.
                    # Prepend "Dataset_ID" to the original header.
                    original_header = actual_data_to_save[0]
                    data_with_dataset_id.append(f"Dataset_ID,{original_header}")
                    
                    # Prepend the current dataset ID to each data row.
                    for i in range(1, len(actual_data_to_save)):
                        data_with_dataset_id.append(f"{current_dataset_id_for_save},{actual_data_to_save[i]}")

                    # Pass the prepared data to the saving function.
                    save_status = save_list_to_csv(data_with_dataset_id, full_file_path)
                    
                    # AFTER a successful save, increment the counter for the NEXT save.
                    sticky_data['current_dataset_id'] += 1
                
    else:
        # --- Set status message if no save is performed ---
        # This branch is typically reached if data is empty, or document path is missing,
        # or during the very first solve before continuous saving is fully active, but controls are set to True.
        
        if _continuous_save_control_state and is_continuous_saving_active:
            save_status = f"Continuous saving active. Data will be saved on every solve. [{datetime.datetime.now().strftime('%H:%M:%S')}]"
        elif _save_once_control_state: 
            save_status = f"Save triggered once. Waiting for continuous save activation. [{datetime.datetime.now().strftime('%H:%M:%S')}]"
        else: # This branch is practically unreachable with current hardcoded settings.
            save_status = "Save controls are OFF (unreachable with current settings)."

    # Always update the sticky states for the next run, unless a reset just happened.
    # If a reset happened, sticky states were already modified at the beginning of the script.
    if not was_reset_this_solve:
        sticky_data['last_save_once_state'] = _save_once_control_state
        sticky_data['is_continuous_saving_active'] = is_continuous_saving_active

# Assign the final status message to the Grasshopper Python output 'a'.
a = save_status

# Print the status message to the Grasshopper console for inspection.
print(a)
# ---------- end py3_4 ----------
panel_9 = Panel(py3_3.out)
panel_10 = Panel(py3_4.out)
opticrosec = OptimizeCrossSectionKaramba3D(
    Model=modelview.Model,
    CrossSections=merge_3,
    MaximumUtilization=1,
    MaximumDisplacement_cm=-1,
    MaximumVirtualWork_kNcm=0.01,
    NumberOfUtilizationIterations=5,
    NumberOfDisplacementIterations=5,
    NumberOfDisplacementIncrementsPerIteration=2,
    DisplacementTolerance=0.01,
    NumberOfSamplePoints=3,
    ElasticDesign=True,
    GammaM0=1,
    GammaM1=1.1,
    SwayFrame=True)  # -> OptimizedModel, Info, Mass_kg, MaximumDisplacement_cm, ElasticEnergyChange_kNm, MaximumUtilizationViewInsufficientCrossSections, MaximumDisplacementViewLimitCrossSections
panel_11 = Panel(opticrosec.Info)

# ---- group: Results
panel_12 = Panel(opticrosec.Mass_kg)
modelview_2 = ModelViewKaramba3D(Model=opticrosec.OptimizedModel)  # -> Model, DeformedMesh, DeformedAxes, DeformedModel, MaximumDeformation
disassemble = DisassembleModelKaramba3D(Model=opticrosec.OptimizedModel)  # -> Model, Point, Beam, Shell, Support, Load, Line, Mesh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
disassemble_2 = DisassembleElementKaramba3D(Element=disassemble.Shell)  # -> Element, ElementIdentifier, AxisOfElement, CrossSection, Joint, Material, LocalCoordinateSystem, ElementIsActive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
disassemble_3 = DisassembleElementKaramba3D(Element=disassemble.Beam)  # -> Element, ElementIdentifier, AxisOfElement, CrossSection, Joint, Material, LocalCoordinateSystem, ElementIsActive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
panel_13 = Panel(disassemble_3.CrossSection)
panel_14 = Panel(disassemble_2.CrossSection)

# ----
py3_5 = Python3Script(x=panel_14, y=button)  # -> out, a; inputs x: list
# ---------- py3_5: Python ----------
import os
import scriptcontext as sc
import datetime  # Used for timestamp in status messages.
import ast       # Used for safe evaluation of string literal lists in input 'x'.
import re        # Used for parsing profile strings.

# --- GH Python Component Inputs ---
# x (data_to_save_raw): Connects to the list of raw profile strings. 
#                       Ensure 'List Access' is set in Grasshopper for this input.
data_to_save_raw = x 
# y (reset_button_input): Connects to a Boolean button (e.g., Grasshopper Button).
#                         Pressing this button (False to True transition) will reset 
#                         the 'current_dataset_id' and the save activation state.
#                         Ensure 'Item Access' is set in Grasshopper for this input.
reset_button_input = y

# Hardcoded filename for this specific component instance, as requested.
file_base_name_in = 'PlateCrosec' 

# Control flags for saving behavior, hardcoded as per user request.
# This setup results in: Save on the very first run, then continuous saving on subsequent runs.
_save_once_control_state = True      # Internal flag corresponding to a "Save Once" button logic.
_continuous_save_control_state = True # Internal flag corresponding to a "Continuous Save" toggle logic.


# --- Helper Function: Save/Append to CSV (Using my previously corrected version) ---
def save_list_to_csv(data_list, file_path):
    """
    Saves a list of strings (each representing a CSV line) to a specified file path.
    If the file does not exist, it creates it and writes all data, including the header (data_list[0]).
    If the file exists, it appends data, skipping the header (data_list[0]) from the new data.
    Creates parent directories if they don't exist.
    """
    if not isinstance(data_list, (list, tuple)) or not data_list:
        return f"Error: Data for saving is not a non-empty list or tuple. Type: {type(data_list)}"

    try:
        dir_name = os.path.dirname(file_path)
        if dir_name:
            os.makedirs(dir_name, exist_ok=True)

        file_exists = os.path.exists(file_path)
        mode = 'a' if file_exists else 'w'

        with open(file_path, mode, encoding='utf-8') as f:
            if mode == 'w':
                # If creating a new file, write all items including the header.
                for item in data_list:
                    f.write(str(item) + '\n')
            elif mode == 'a':
                # If appending to an existing file, skip the header (data_list[0]) and write only data rows.
                # Ensure data_list has at least 2 elements (header + at least one data row) to append safely.
                if len(data_list) > 1: 
                    for i in range(1, len(data_list)): # Start from index 1 to skip the header
                        f.write(str(data_list[i]) + '\n')
                else: # Only header was provided in data_list for appending, which is incorrect.
                    return f"Warning: Attempted to append with only a header in data_list for {file_path}. No data written."
        
        current_status_time = datetime.datetime.now().strftime('%H:%M:%S') 
        action = "Appended" if file_exists else "Created"
        return f"[{current_status_time}] Successfully {action} and saved to: {file_path}"
    except Exception as e:
        return f"Error saving file {file_path}: {e}"

# --- Helper Function: Parse Profile String (Using your provided version for Plate data) ---
def parse_specific_profile_data(profile_string):
    """
    Parses a single profile string (Plate data format) to extract 'family', 'face 1:height', and 'face 2:height'.
    Returns a dictionary with extracted data. Missing data will have empty strings.
    """
    data = {
        'family': '',
        'face1_height_cm': '',
        'face2_height_cm': ''
    }

    # 1. Extract 'family'
    match_family = re.search(r"family:'([^']*)'", profile_string)
    if match_family:
        data['family'] = match_family.group(1)
    
    # 2. Extract 'face 1:height'
    match_face1_height = re.search(r"face 1:height:(\d+\.?\d*)(?:\[cm\])?", profile_string)
    if match_face1_height:
        data['face1_height_cm'] = match_face1_height.group(1)

    # 3. Extract 'face 2:height'
    match_face2_height = re.search(r"face 2:height:(\d+\.?\d*)(?:\[cm\])?", profile_string)
    if match_face2_height:
        data['face2_height_cm'] = match_face2_height.group(1)
        
    return data


# --- GH Python Component Execution ---

save_status = "Ready to save." # Initialize output status message.
error_occurred = False        # Flag for issues during data preprocessing.
was_reset_this_solve = False  # Flag to prevent saving if a reset was triggered this solve.

# Use sc.sticky for persistent data storage unique to this component instance.
sticky_data = sc.sticky 

# --- Initialize or Retrieve Sticky Variables ---
# 'last_save_once_state': Stores the state of the '_save_once_control_state' from the previous solve.
# This helps detect the initial "press" for 'save once' logic.
if 'last_save_once_state' not in sticky_data:
    sticky_data['last_save_once_state'] = False

# 'is_continuous_saving_active': Flag indicating if continuous saving has been activated.
# Activated after the first "save once" trigger.
if 'is_continuous_saving_active' not in sticky_data:
    sticky_data['is_continuous_saving_active'] = False

# 'current_dataset_id': Unique sequential ID for each saved dataset. Starts at 0.
if 'current_dataset_id' not in sticky_data:
    sticky_data['current_dataset_id'] = 0

# 'last_reset_button_state': Stores the boolean state of the 'reset_button_input' from the previous solve.
# This allows detection of a False -> True transition (button press).
if 'last_reset_button_state' not in sticky_data:
    sticky_data['last_reset_button_state'] = False

# Retrieve states from sticky for current solve's logic.
last_save_once_state = sticky_data['last_save_once_state']
is_continuous_saving_active = sticky_data['is_continuous_saving_active']

# --- Reset Logic: Detect 'y' button press (False to True transition) ---
current_reset_button_state = reset_button_input
last_reset_button_state_from_sticky = sticky_data['last_reset_button_state']

if current_reset_button_state and not last_reset_button_state_from_sticky:
    # A reset has been triggered!
    # Reset 'current_dataset_id' to 0.
    sticky_data['current_dataset_id'] = 0
    # Reset save activation states to re-initiate the "save once then continuous" cycle.
    sticky_data['last_save_once_state'] = False 
    sticky_data['is_continuous_saving_active'] = False
    
    save_status = f"[{datetime.datetime.now().strftime('%H:%M:%S')}] Dataset ID and save activation states have been reset for '{file_base_name_in}'. "
    was_reset_this_solve = True # Prevent saving data in the same solve a reset occurred.
    
# Always update the last state of the reset button for the next solve.
sticky_data['last_reset_button_state'] = current_reset_button_state

# --- Data Preprocessing: Flatten potential string-list-literals from input 'x' ---
# Handles cases where 'x' might receive string representations of lists (e.g., from a Panel),
# flattening them into a single list of raw data strings.
actual_data_to_save = [] 
if data_to_save_raw:
    # Check if the first item looks like a string representation of a list.
    is_x_a_list_of_string_lists = isinstance(data_to_save_raw, list) and len(data_to_save_raw) > 0 and \
                                   isinstance(data_to_save_raw[0], str) and data_to_save_raw[0].strip().startswith('[')
    
    if is_x_a_list_of_string_lists:
        for item_str_literal in data_to_save_raw:
            if isinstance(item_str_literal, str):
                try:
                    inner_data = ast.literal_eval(item_str_literal)
                    if isinstance(inner_data, list):
                        actual_data_to_save.extend(inner_data) 
                    else:
                        actual_data_to_save.append(str(inner_data))
                except (ValueError, SyntaxError) as e:
                    save_status = f"Error: Input data format issue - cannot parse '{item_str_literal}' as a Python literal: {e}"
                    error_occurred = True 
                    break 
            else:
                actual_data_to_save.append(str(item_str_literal))
    else: # If data_to_save_raw is already a flat list of strings/objects, use it directly.
        actual_data_to_save = data_to_save_raw
else:
    actual_data_to_save = [] # Ensure it's an empty list if no input is provided.

# --- Only proceed with save logic if no preprocessing error occurred and no reset happened ---
if not error_occurred and not was_reset_this_solve:
    # --- Determine if a save operation should be performed ---
    # 'save_once_pressed' detects the initial transition of '_save_once_control_state' from False to True.
    # Since '_save_once_control_state' is hardcoded True, this will be True only on the very first component solve,
    # or after a reset.
    save_once_pressed = _save_once_control_state and not last_save_once_state

    # Activate continuous saving after the initial 'save once' trigger.
    # Since '_continuous_save_control_state' is hardcoded True, 'is_continuous_saving_active' will
    # become True on the first solve (when 'save_once_pressed' is True) and remain True thereafter,
    # or until a reset.
    if _continuous_save_control_state and save_once_pressed: 
        is_continuous_saving_active = True

    should_perform_save = False
    if save_once_pressed: # Condition for the very first save (or first after reset).
        should_perform_save = True
    elif _continuous_save_control_state and is_continuous_saving_active: # Condition for all subsequent continuous saves.
        should_perform_save = True

    # --- Execute save logic if conditions are met ---
    if should_perform_save:
        gh_doc_path = sc.doc.Path
        
        if not gh_doc_path:
            save_status = "Error: Grasshopper document not saved. Save the .gh file first to determine output path."
        else:
            gh_doc_dir = os.path.dirname(gh_doc_path)
            data_subfolder_name = "data_save"
            target_dir = os.path.join(gh_doc_dir, data_subfolder_name)
            
            if not file_base_name_in:
                save_status = "Error: Please provide a 'file_base_name' for the output CSV."
            else:
                final_file_name = f"{file_base_name_in}.csv"
                full_file_path = os.path.join(target_dir, final_file_name)
                
                if not actual_data_to_save:
                    save_status = f"Warning: Input data for '{final_file_name}' is empty. No data will be written to: {full_file_path}"
                else:
                    # Get the current dataset ID before using it for this save operation.
                    current_dataset_id_for_save = sticky_data['current_dataset_id']
                    
                    processed_csv_lines = []
                    
                    # Define the ordered list of headers for the *specific* requested Plate data.
                    header_columns = [
                        "family", "face1_height_cm", "face2_height_cm"
                    ]
                    
                    # Add the overall header for the CSV, including the 'Dataset_ID' column.
                    processed_csv_lines.append(f"Dataset_ID,{','.join(header_columns)}")
                    
                    # Parse each raw profile string and format it for CSV.
                    for raw_profile_str in actual_data_to_save:
                        if isinstance(raw_profile_str, str): # Ensure we are processing strings.
                            parsed_data = parse_specific_profile_data(raw_profile_str)
                            # Collect values in the order defined by header_columns. Use empty string for missing data.
                            row_values = [str(parsed_data.get(col, '')) for col in header_columns]
                            processed_csv_lines.append(f"{current_dataset_id_for_save},{','.join(row_values)}")
                        else:
                            # Log a warning if an item in the input list is not a string as expected.
                            print(f"Warning: Skipping non-string item in input profile list: {raw_profile_str}")

                    # Pass the prepared data to the saving function.
                    save_status = save_list_to_csv(processed_csv_lines, full_file_path)
                    
                    # AFTER a successful save, increment the counter for the NEXT save.
                    sticky_data['current_dataset_id'] += 1
                
    else:
        # --- Set status message if no save is performed ---
        if _continuous_save_control_state and is_continuous_saving_active:
            save_status = f"Continuous saving active for '{file_base_name_in}'. Data will be saved on every solve. [{datetime.datetime.now().strftime('%H:%M:%S')}]"
        elif _save_once_control_state: 
            save_status = f"'{file_base_name_in}': Save triggered once. Waiting for continuous save activation. [{datetime.datetime.now().strftime('%H:%M:%S')}]"
        else: # This branch is practically unreachable with current hardcoded settings.
            save_status = f"'{file_base_name_in}': Save controls are OFF (unreachable with current settings)."

    # Always update the sticky states for the next run, unless a reset just happened.
    # If a reset happened, sticky states were already modified at the beginning of the script.
    if not was_reset_this_solve:
        sticky_data['last_save_once_state'] = _save_once_control_state
        sticky_data['is_continuous_saving_active'] = is_continuous_saving_active

# Assign the final status message to the Grasshopper Python output 'a'.
a = save_status

# Print the status message to the Grasshopper console for inspection.
print(a)
# ---------- end py3_5 ----------
py3_6 = Python3Script(x=panel_13, y=button)  # -> out, a; inputs x: list
# ---------- py3_6: Python ----------
import os
import scriptcontext as sc
import datetime  # Used for timestamp in status messages.
import ast       # Used for safe evaluation of string literal lists in input 'x'.
import re        # Used for parsing profile strings.

# --- GH Python Component Inputs ---
# x (data_to_save_raw): Connects to the list of raw profile strings. 
#                       Ensure 'List Access' is set in Grasshopper for this input.
data_to_save_raw = x 
# y (reset_button_input): Connects to a Boolean button (e.g., Grasshopper Button).
#                         Pressing this button (False to True transition) will reset 
#                         the 'current_dataset_id' and the save activation state.
#                         Ensure 'Item Access' is set in Grasshopper for this input.
reset_button_input = y

# Hardcoded filename for this specific component instance, as requested.
file_base_name_in = 'FrameCrosec' 

# Control flags for saving behavior, hardcoded as per user request.
# This setup results in: Save on the very first run, then continuous saving on subsequent runs.
_save_once_control_state = True      # Internal flag corresponding to a "Save Once" button logic.
_continuous_save_control_state = True # Internal flag corresponding to a "Continuous Save" toggle logic.


# --- Helper Function: Save/Append to CSV ---
def save_list_to_csv(data_list, file_path):
    """
    Saves a list of strings (each representing a CSV line) to a specified file path.
    If the file does not exist, it creates it and writes all data, including the header (data_list[0]).
    If the file exists, it appends data, skipping the header (data_list[0]) from the new data.
    Creates parent directories if they don't exist.
    """
    if not isinstance(data_list, (list, tuple)) or not data_list:
        return f"Error: Data for saving is not a non-empty list or tuple. Type: {type(data_list)}"

    try:
        dir_name = os.path.dirname(file_path)
        if dir_name:
            os.makedirs(dir_name, exist_ok=True)

        file_exists = os.path.exists(file_path)
        mode = 'a' if file_exists else 'w'

        with open(file_path, mode, encoding='utf-8') as f:
            if mode == 'w':
                # If creating a new file, write all items including the header.
                for item in data_list:
                    f.write(str(item) + '\n')
            elif mode == 'a':
                # If appending to an existing file, skip the header (data_list[0]) and write only data rows.
                # Ensure data_list has at least 2 elements (header + at least one data row) to append safely.
                if len(data_list) > 1: 
                    for i in range(1, len(data_list)): # Start from index 1 to skip the header
                        f.write(str(data_list[i]) + '\n')
                else: # Only header was provided in data_list for appending, which is incorrect.
                    return f"Warning: Attempted to append with only a header in data_list for {file_path}. No data written."
        
        current_status_time = datetime.datetime.now().strftime('%H:%M:%S') 
        action = "Appended" if file_exists else "Created"
        return f"[{current_status_time}] Successfully {action} and saved to: {file_path}"
    except Exception as e:
        return f"Error saving file {file_path}: {e}"

# --- Helper Function: Parse Profile String ---
def parse_specific_profile_data(profile_string):
    """
    Parses a single profile string to extract 'family', 'height', 'Flange-width', and 'A'.
    - 'family' is extracted directly.
    - 'height' and 'Flange-width' capture the first occurrence in the string.
    - 'A' (Area) is captured globally, assuming it's unique or the one from Trapezoid.
    Returns a dictionary with extracted data. Missing data will have empty strings.
    """
    data = {
        'family': '',
        'height_cm': '',
        'Flange_width_cm': '',
        'Area_cm2': ''
    }

    match_family = re.search(r"family:'([^']*)'", profile_string)
    if match_family:
        data['family'] = match_family.group(1)

    match_height = re.search(r"height:(\d+\.?\d*)(?:\[cm\])?", profile_string)
    if match_height:
        data['height_cm'] = match_height.group(1)

    match_flange_width = re.search(r"Flange-width:(\d+\.?\d*)(?:\[cm\])?", profile_string)
    if match_flange_width:
        data['Flange_width_cm'] = match_flange_width.group(1)

    match_area = re.search(r"A:(\d+\.?\d*)(?:\[cm²\])?", profile_string)
    if match_area:
        data['Area_cm2'] = match_area.group(1)

    return data


# --- GH Python Component Execution ---

save_status = "Ready to save." # Initialize output status message.
error_occurred = False        # Flag for issues during data preprocessing.
was_reset_this_solve = False  # Flag to prevent saving if a reset was triggered this solve.

# Use sc.sticky for persistent data storage unique to this component instance.
sticky_data = sc.sticky 

# --- Initialize or Retrieve Sticky Variables ---
# 'last_save_once_state': Stores the state of the '_save_once_control_state' from the previous solve.
# This helps detect the initial "press" for 'save once' logic.
if 'last_save_once_state' not in sticky_data:
    sticky_data['last_save_once_state'] = False

# 'is_continuous_saving_active': Flag indicating if continuous saving has been activated.
# Activated after the first "save once" trigger.
if 'is_continuous_saving_active' not in sticky_data:
    sticky_data['is_continuous_saving_active'] = False

# 'current_dataset_id': Unique sequential ID for each saved dataset. Starts at 0.
if 'current_dataset_id' not in sticky_data:
    sticky_data['current_dataset_id'] = 0

# 'last_reset_button_state': Stores the boolean state of the 'reset_button_input' from the previous solve.
# This allows detection of a False -> True transition (button press).
if 'last_reset_button_state' not in sticky_data:
    sticky_data['last_reset_button_state'] = False

# Retrieve states from sticky for current solve's logic.
last_save_once_state = sticky_data['last_save_once_state']
is_continuous_saving_active = sticky_data['is_continuous_saving_active']

# --- Reset Logic: Detect 'y' button press (False to True transition) ---
current_reset_button_state = reset_button_input
last_reset_button_state_from_sticky = sticky_data['last_reset_button_state']

if current_reset_button_state and not last_reset_button_state_from_sticky:
    # A reset has been triggered!
    # Reset 'current_dataset_id' to 0.
    sticky_data['current_dataset_id'] = 0
    # Reset save activation states to re-initiate the "save once then continuous" cycle.
    sticky_data['last_save_once_state'] = False 
    sticky_data['is_continuous_saving_active'] = False
    
    save_status = f"[{datetime.datetime.now().strftime('%H:%M:%S')}] Dataset ID and save activation states have been reset for '{file_base_name_in}'. "
    was_reset_this_solve = True # Prevent saving data in the same solve a reset occurred.
    
# Always update the last state of the reset button for the next solve.
sticky_data['last_reset_button_state'] = current_reset_button_state

# --- Data Preprocessing: Flatten potential string-list-literals from input 'x' ---
# Handles cases where 'x' might receive string representations of lists (e.g., from a Panel),
# flattening them into a single list of raw data strings.
actual_data_to_save = [] 
if data_to_save_raw:
    # Check if the first item looks like a string representation of a list.
    is_x_a_list_of_string_lists = isinstance(data_to_save_raw, list) and len(data_to_save_raw) > 0 and \
                                   isinstance(data_to_save_raw[0], str) and data_to_save_raw[0].strip().startswith('[')
    
    if is_x_a_list_of_string_lists:
        for item_str_literal in data_to_save_raw:
            if isinstance(item_str_literal, str):
                try:
                    inner_data = ast.literal_eval(item_str_literal)
                    if isinstance(inner_data, list):
                        actual_data_to_save.extend(inner_data) 
                    else:
                        actual_data_to_save.append(str(inner_data))
                except (ValueError, SyntaxError) as e:
                    save_status = f"Error: Input data format issue - cannot parse '{item_str_literal}' as a Python literal: {e}"
                    error_occurred = True 
                    break 
            else:
                actual_data_to_save.append(str(item_str_literal))
    else: # If data_to_save_raw is already a flat list of strings/objects, use it directly.
        actual_data_to_save = data_to_save_raw
else:
    actual_data_to_save = [] # Ensure it's an empty list if no input is provided.

# --- Only proceed with save logic if no preprocessing error occurred and no reset happened ---
if not error_occurred and not was_reset_this_solve:
    # --- Determine if a save operation should be performed ---
    # 'save_once_pressed' detects the initial transition of '_save_once_control_state' from False to True.
    # Since '_save_once_control_state' is hardcoded True, this will be True only on the very first component solve,
    # or after a reset.
    save_once_pressed = _save_once_control_state and not last_save_once_state

    # Activate continuous saving after the initial 'save once' trigger.
    # Since '_continuous_save_control_state' is hardcoded True, 'is_continuous_saving_active' will
    # become True on the first solve (when 'save_once_pressed' is True) and remain True thereafter,
    # or until a reset.
    if _continuous_save_control_state and save_once_pressed: 
        is_continuous_saving_active = True

    should_perform_save = False
    if save_once_pressed: # Condition for the very first save (or first after reset).
        should_perform_save = True
    elif _continuous_save_control_state and is_continuous_saving_active: # Condition for all subsequent continuous saves.
        should_perform_save = True

    # --- Execute save logic if conditions are met ---
    if should_perform_save:
        gh_doc_path = sc.doc.Path
        
        if not gh_doc_path:
            save_status = "Error: Grasshopper document not saved. Save the .gh file first to determine output path."
        else:
            gh_doc_dir = os.path.dirname(gh_doc_path)
            data_subfolder_name = "data_save"
            target_dir = os.path.join(gh_doc_dir, data_subfolder_name)
            
            if not file_base_name_in:
                save_status = "Error: Please provide a 'file_base_name' for the output CSV."
            else:
                final_file_name = f"{file_base_name_in}.csv"
                full_file_path = os.path.join(target_dir, final_file_name)
                
                if not actual_data_to_save:
                    save_status = f"Warning: Input data for '{final_file_name}' is empty. No data will be written to: {full_file_path}"
                else:
                    # Get the current dataset ID before using it for this save operation.
                    current_dataset_id_for_save = sticky_data['current_dataset_id']
                    
                    processed_csv_lines = []
                    
                    # Define the ordered list of headers for the *specific* requested data from parsing.
                    header_columns = [
                        "family", "height_cm", "Flange_width_cm", "Area_cm2"
                    ]
                    
                    # Add the overall header for the CSV, including the 'Dataset_ID' column.
                    processed_csv_lines.append(f"Dataset_ID,{','.join(header_columns)}")
                    
                    # Parse each raw profile string and format it for CSV.
                    for raw_profile_str in actual_data_to_save:
                        if isinstance(raw_profile_str, str): # Ensure we are processing strings.
                            parsed_data = parse_specific_profile_data(raw_profile_str)
                            # Collect values in the order defined by header_columns. Use empty string for missing data.
                            row_values = [str(parsed_data.get(col, '')) for col in header_columns]
                            processed_csv_lines.append(f"{current_dataset_id_for_save},{','.join(row_values)}")
                        else:
                            # Log a warning if an item in the input list is not a string as expected.
                            print(f"Warning: Skipping non-string item in input profile list: {raw_profile_str}")

                    # Pass the prepared data to the saving function.
                    save_status = save_list_to_csv(processed_csv_lines, full_file_path)
                    
                    # AFTER a successful save, increment the counter for the NEXT save.
                    sticky_data['current_dataset_id'] += 1
                
    else:
        # --- Set status message if no save is performed ---
        # This branch is typically reached if data is empty, or document path is missing,
        # or during the very first solve before continuous saving is fully active, but controls are set to True.
        
        if _continuous_save_control_state and is_continuous_saving_active:
            save_status = f"Continuous saving active for '{file_base_name_in}'. Data will be saved on every solve. [{datetime.datetime.now().strftime('%H:%M:%S')}]"
        elif _save_once_control_state: 
            # This state means _save_once_control_state is True, but it hasn't transitioned from False yet
            # (i.e., first solve OR after a reset where last_save_once_state becomes False again).
            save_status = f"'{file_base_name_in}': Save triggered once. Waiting for continuous save activation. [{datetime.datetime.now().strftime('%H:%M:%S')}]"
        else: # This branch is practically unreachable with current hardcoded settings.
            save_status = f"'{file_base_name_in}': Save controls are OFF (unreachable with current settings)."

    # Always update the sticky states for the next run, unless a reset just happened.
    # If a reset happened, sticky states were already modified at the beginning of the script.
    if not was_reset_this_solve:
        sticky_data['last_save_once_state'] = _save_once_control_state
        sticky_data['is_continuous_saving_active'] = is_continuous_saving_active

# Assign the final status message to the Grasshopper Python output 'a'.
a = save_status

# Print the status message to the Grasshopper console for inspection.
print(a)
# ---------- end py3_6 ----------
panel_15 = Panel(py3_5.out)
panel_16 = Panel(py3_6.out)
